# Grasshopper definition NA_GeneratingSites.gh (Grasshopper 1.0.7)
# plug-ins: UrbanXTools

# ---- group: 1
curve = Curve([<curve referenced from the Rhino model> x11])

# ---- group: 2
curve_2 = Curve([<curve referenced from the Rhino model> x8])

# ---- group: 3
curve_3 = Curve([<curve referenced from the Rhino model> x6])

# ----
curve_4 = Curve(<curve referenced from the Rhino model>)
merge = Merge(Data1=Slider(74, range=0..100), Data2=Slider(36, range=0..100), Data3=Slider(30, range=0..100))
na_generatingsites = NA_GeneratingSites(
    MainRoads=curve,
    SecondaryRoads=curve_2,
    TertiaryRoads=curve_3,
    RoadsDistances=merge,
    RoundRadius=Slider(28, range=0..100),
    Boundary=curve_4)
merge_2 = Merge(Data1=curve, Data2=curve_2, Data3=curve_3)
custom_preview = CustomPreview(
    Geometry=na_generatingsites,
    Material={diffuse=RGB(221, 160, 221), emission=RGB(66, 48, 66), shine=0.5, specular=RGB(255, 255, 255), transparency=0})
number_slider = Slider(6000, range=0..10000)
global = Panel("-1")

# ----
# 设计地块
curve_5 = Curve()

curve_6 = Curve(merge_2)
ns_computing3d = NS_Computing3D(RoadsData=curve_6, Radius=global, Merge=Toggle(True))  # -> MetricChoice, MetricIntegration, MetricMeanDepth, MetricTotalDepth, AngularChoice, AngularIntegration, AngularMeanDepth, AngularTotalDepth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

data = Data(ns_computing3d.CleanedRoadsData)
data_2 = Data(ns_computing3d.NormalisedAngularChoice)
display = Display(parameter=data_2)
curve_middle = CurveMiddle(Curve=data)
text_tag_3d = TextTag3D(Location=curve_middle, Text=data_2, Size=30, Colour=ColourSwatch(SwatchColor=RGB(255, 255, 255)), Justification=7)
custom_preview_2 = CustomPreview(Geometry=data, Material=display)

# ----
# sites accessibility
na_clearsitesdata = NA_ClearSitesData(OriginalSitesData=curve_5)
na_siteaccessibility = NA_SiteAccessibility(RoadsSegments=ns_computing3d.CleanedRoadsData, RoadsScores=data_2, SitesCurves=na_clearsitesdata)  # -> SitesPolygons, SiteScores
display_2 = Display(parameter=na_siteaccessibility.SiteScores)
boundary_surfaces = BoundarySurfaces(Edges=na_siteaccessibility.SitesPolygons)
custom_preview_3 = CustomPreview(Geometry=boundary_surfaces, Material=display_2)

# ==== cluster Display
parameter = ClusterInput()
bounds = Bounds(Numbers=parameter)
deconstruct_domain = DeconstructDomain(Domain=bounds)  # -> Start, End
gradient = Gradient(
    LowerLimit=deconstruct_domain.Start,
    UpperLimit=deconstruct_domain.End,
    Parameter=parameter,
    stops=[0: RGB(0, 128, 0), 0.528: RGB(255, 255, 0), 1: RGB(255, 0, 0)])
colour = ClusterOutput(gradient)
panel = Panel(gradient)
