# Grasshopper definition networkAnalysis.gh (Grasshopper 1.0.7)
# plug-ins: UrbanXTools, Human

# ----
# imported sites
curve = Curve([<curve referenced from the Rhino model> x527])

# ----
# chosen area for calculating road density
curve_2 = Curve(<curve referenced from the Rhino model>)

# ----
# imported road networks
curve_3 = Curve([<curve referenced from the Rhino model> x62])

na_roaddensity = NA_RoadDensity(Roads=curve_3, Boundary=curve_2)  # -> RoadDensityDouble, RoadDensityString, CurvesInBoundary
ns_computing3d = NS_Computing3D(RoadsData=curve_3, Radius=Slider(6000, range=0..10000), Merge=Toggle(True))  # -> MetricChoice, MetricIntegration, MetricMeanDepth, MetricTotalDepth, AngularChoice, AngularIntegration, AngularMeanDepth, AngularTotalDepth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
panel = Panel(na_roaddensity.RoadDensityString)
cluster = Cluster(data=ns_computing3d.NormalisedAngularChoice)  # -> colour, data_3

# ----
# sites accessibility
na_clearsitesdata = NA_ClearSitesData(OriginalSitesData=curve)
na_siteaccessibility = NA_SiteAccessibility(RoadsScores=cluster.data_3, SitesCurves=na_clearsitesdata)  # -> SitesPolygons, SiteScores
display = Display(parameter=na_siteaccessibility.SiteScores)
boundary_surfaces = BoundarySurfaces(Edges=na_siteaccessibility.SitesPolygons)
custom_preview = CustomPreview(Geometry=boundary_surfaces, Material=display)

# ----
# roads accessibility
data = Data(ns_computing3d.CleanedRoadsData)
curve_middle = CurveMiddle(Curve=data)
text_tag_3d = TextTag3D(Location=curve_middle, Text=cluster.data_3, Size=30, Justification=7)

custom_preview_lineweights = CustomPreviewLineweights(Geometry=data, Shader=cluster.colour, Thickness=Slider(3, range=0..10), Absolute=False)

# ==== cluster Display
parameter = ClusterInput()
bounds = Bounds(Numbers=parameter)
deconstruct_domain = DeconstructDomain(Domain=bounds)  # -> Start, End
gradient = Gradient(
    LowerLimit=deconstruct_domain.Start,
    UpperLimit=deconstruct_domain.End,
    Parameter=parameter,
    stops=[0: RGB(0, 128, 0), 0.351: RGB(255, 255, 0), 1: RGB(255, 0, 0)])
colour = ClusterOutput(gradient)
panel = Panel(gradient)

# ==== cluster Cluster
data = ClusterInput()
data_2 = Data(data)
data_3 = ClusterOutput(data_2)
bounds = Bounds(Numbers=data_2)
deconstruct_domain = DeconstructDomain(Domain=bounds)  # -> Start, End
gradient = Gradient(
    LowerLimit=deconstruct_domain.Start,
    UpperLimit=deconstruct_domain.End,
    Parameter=data_2,
    stops=[0: RGB(0, 128, 0), 0.5: RGB(255, 255, 0), 1: RGB(255, 0, 0)])
colour = ClusterOutput(gradient)
