# Grasshopper definition facilityCoverage.gh (Grasshopper 1.0.7)
# plug-ins: UrbanXTools

# ----
# 服务半径
number_slider = Slider(1668, range=0..10000)

# ----
# 设计路网
curve = Curve([<curve referenced from the Rhino model> x88])

# ----
# 设计地块
curve_2 = Curve([<curve referenced from the Rhino model> x527])

# ----
# 公服地块
curve_3 = Curve([<curve referenced from the Rhino model> x7])

na_clearroadsdata = NA_ClearRoadsData(OriginalRoadsData=curve)
fl_connecttonetwork = FL_ConnectToNetwork(RoadsCurves=na_clearroadsdata, SitesCurves=curve_2)  # -> RoadsNetwork, RoadsSegments
fl_coveragearea = FL_CoverageArea(RoadsNetwork=fl_connecttonetwork.RoadsNetwork, SourceSites=curve_3, NetworkRadius=number_slider)  # -> CoveredSites, CoveredSitesCentroids
area = Area(Geometry=curve_3)  # -> Area, graft(Centroid)
boundary_surfaces = BoundarySurfaces(Edges=fl_coveragearea.CoveredSites)
line = Line(StartPoint=area.Centroid, EndPoint=fl_coveragearea.CoveredSitesCentroids)
custom_preview = CustomPreview(Geometry=line, Material=ColourSwatch(SwatchColor=RGB(255, 255, 255)))
custom_preview_2 = CustomPreview(Geometry=boundary_surfaces, Material=ColourSwatch(SwatchColor=RGBA(122, 191, 255, 146)))
