# Grasshopper definition urbanDesign_Calculator.gh (Grasshopper 1.0.7)
# plug-ins: UrbanXTools

# ----
# 建筑层数范围
number_slider = Slider(1, range=0..1)
construct_domain = ConstructDomain(DomainStart=Slider(6, range=0..10), DomainEnd=Slider(30, range=0..100))
construct_domain_2 = ConstructDomain(DomainStart=Slider(2, range=0..10), DomainEnd=Slider(60, range=0..100))
construct_domain_3 = ConstructDomain(DomainStart=number_slider, DomainEnd=Slider(10, range=0..10))
merge = Merge(Data1=construct_domain_3, Data2=construct_domain, Data3=construct_domain_2)

# ----
# 目标建筑密度
number_slider_2 = Slider(0.3, range=0..1)

# ----
# 目标容积率
number_slider_3 = Slider(3.5, range=0..10)

# ----
# 设计地块
curve = Curve(<curve referenced from the Rhino model>)

# ----
# 建筑外轮廓线
curve_2 = Curve([<curve referenced from the Rhino model> x3])

ud_designcalculator = UD_DesignCalculator(SiteCurve=curve, Buildings=curve_2, FloorsRange=merge, TargetFAR=number_slider_3, TargetDensity=number_slider_2)  # -> TypeCounts, TypeFloors, AccurateFAR, AccurateDensity

# ----
# 计算结果
panel = Panel(ud_designcalculator.TypeCounts)
panel_2 = Panel(ud_designcalculator.TypeFloors)
panel_3 = Panel(ud_designcalculator.AccurateDensity)
panel_4 = Panel(ud_designcalculator.AccurateFAR)
