# Grasshopper definition urbanDesign_DynamicSplit.gh (Grasshopper 1.0.7)
# plug-ins: UrbanXTools

# 地块BoundingBox可达性得分
panel = Panel("""10
10
10
10""")
# 建筑面积数列
panel_2 = Panel("""200
300
600
150
320
456""")
# 建筑动静属性
panel_3 = Panel("""1
2
3
4
5
6""")

# ----
# 设计地块
curve = Curve(<curve referenced from the Rhino model>)

ud_dynamicsplit = UD_DynamicSplit(
    SiteCurve=curve,
    AreasList=panel_2,
    Priorities=panel_3,
    Accessibilties=panel,
    SplitAngle=Slider(-0.48, range=-1..1),
    RenewAngle=Toggle(False))  # -> SubSites, SubEdges, EdgeScores, SubAngles, SubIndex, BSPTree
boundary_surfaces = BoundarySurfaces(Edges=ud_dynamicsplit.SubSites)
panel_4 = Panel(ud_dynamicsplit.BSPTree)
custom_preview = CustomPreview(
    Geometry=ud_dynamicsplit.SubEdges,
    Material={diffuse=RGB(221, 160, 221), emission=RGB(66, 48, 66), shine=0.5, specular=RGB(255, 255, 255), transparency=0})
