# Grasshopper definition urbanDesign_ResidentialLimit.gh (Grasshopper 1.0.7)
# plug-ins: UrbanXTools

# ----
# 建筑朝向
number_slider = Slider(-0.36, range=-1..1)

# ----
# 地块建筑限高（m）
number_slider_2 = Slider(100, range=0..100)

# ----
# 所属城市
value_list = ValueList({"北京": 0, "上海": 1, "天津": 2, "深圳": 3}, selected="北京")

# ----
# 设计地块
curve = Curve(<curve referenced from the Rhino model>)

ud_residentiallimitation = UD_ResidentialLimitation(
    SiteCurve=curve,
    CityIndex=value_list,
    HeightLimit=number_slider_2,
    FloorHeight=3,
    Orientation=number_slider,
    BuildingDepth=26)  # -> MaxFAR, MaxDensity

# ----
# 基于输入条件地块容积率上限
panel = Panel(ud_residentiallimitation.MaxFAR)

# ----
# 最大容积率时建筑密度上限
panel_2 = Panel(ud_residentiallimitation.MaxDensity)
