# Grasshopper definition urbanDesign_multiSites.gh (Grasshopper 1.0.7)
# plug-ins: UrbanXTools

# ----
# 设计路网
curve = Curve([<curve referenced from the Rhino model> x88])

# ----
# 设计地块（多地块）
# 注意：需保证地块顺序与参数顺序一致
curve_2 = Curve([<curve referenced from the Rhino model> x3])

# ----
# 建筑朝向
gene_pool = GenePool(Decimals=3, Maximum=1, Minimum=-1, Value=[0.027, 0.186, 0.404])

# ----
# 地块类型
用地类型_深标 = ValueList({"居住用地R": 0, "商业用地C": 1, "公共管理用地GIC": 2, "仓储用地": 3, "工业用地": 4}, selected="居住用地R")
用地类型_深标_2 = ValueList({"居住用地R": 0, "商业用地C": 1, "公共管理用地GIC": 2, "仓储用地": 3, "工业用地": 4}, selected="商业用地C")
用地类型_深标_3 = ValueList({"居住用地R": 0, "商业用地C": 1, "公共管理用地GIC": 2, "仓储用地": 3, "工业用地": 4}, selected="居住用地R")
merge = Merge(Data1=用地类型_深标_2, Data2=用地类型_深标_3, Data3=用地类型_深标)

# ----
# 地块建筑形态
非住宅建筑形态类型 = ValueList({"单点式": 0, "围合式": 1, "混合式": 2}, selected="混合式")
住宅建筑形态类型 = ValueList({"行列式": 0, "单点式": 1}, selected="行列式")
# 注意：目前工业和仓储用地建筑只有单点式风格
非住宅建筑形态类型_2 = ValueList({"单点式": 0, "围合式": 1, "混合式": 2}, selected="单点式")

# ----
# 地块目标容积率
gene_pool_2 = GenePool(Decimals=3, Maximum=10, Minimum=0, Value=[5.031, 2.486, 1.446])

# ----
# 地块目标建筑密度
gene_pool_3 = GenePool(Decimals=3, Maximum=1, Minimum=0, Value=[0.381, 0.421, 0.275])

# ----
# 地块目标功能混合率
gene_pool_4 = GenePool(Decimals=3, Maximum=1, Minimum=0, Value=[0.19, 0.205, 0.275])

# ----
# 所属城市
value_list = ValueList({"北京": 0, "上海": 1, "天津": 2, "深圳": 3}, selected="深圳")

merge_2 = Merge(Data1=非住宅建筑形态类型, Data2=住宅建筑形态类型, Data3=非住宅建筑形态类型_2)

# ----
# 路网可达性计算
na_computing = NA_Computing(RoadsData=curve, Radius=Slider(6000, range=0..10000))  # -> MetricChoice, MetricIntegration, MetricMeanDepth, MetricTotalDepth, AngularChoice, AngularIntegration, AngularMeanDepth, AngularTotalDepth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
data = Data(na_computing.MetricChoice)
display = Display(parameter=data)

data_2 = Data(na_computing.CleanedRoadsData)

# ----
# 1_计算地块初始参数
ud_siteparameter = UD_SiteParameter(AllRoads=data_2, AllScores=data, AllSites=curve_2)

# ----
# 2_设定地块目标参数
ud_siteparameterextra = UD_SiteParameterExtra(
    SiteParameters=ud_siteparameter,
    SiteTypes=merge,
    SiteFARs=gene_pool_2,
    Densities=gene_pool_3,
    MixRatios=gene_pool_4,
    BuidlingStyles=merge_2,
    MainOritation=gene_pool)

# ----
# 3_生成地块建筑方案
ud_sitegenerateplans = UD_SiteGeneratePlans(SiteParameters=ud_siteparameterextra, CityIndex=value_list)  # -> SiteResults, Sites, FARs, Densities, SubSites, SubSitesSetbacks, BuildingLayers, BuildingRoofs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

custom_preview = CustomPreview(Geometry=data_2, Material=display)

panel = Panel(ud_sitegenerateplans.FARs)
panel_2 = Panel(ud_sitegenerateplans.Densities)

# ----
# 功能显示
cluster = Cluster(brep=ud_sitegenerateplans.BuildingBreps, data=ud_sitegenerateplans.BuildingFunctions)  # -> brep_3, color
preview = CustomPreview(Geometry=cluster.brep_3, Material=cluster.color)

# ----
# 显示设定
colour_swatch = ColourSwatch(SwatchColor=RGB(141, 171, 82))
boundary_surfaces = BoundarySurfaces(Edges=ud_sitegenerateplans.SubSitesSetbacks)
boundary_surfaces_2 = BoundarySurfaces(Edges=ud_sitegenerateplans.SubSites)
extrude = Extrude(Base=boundary_surfaces_2, Direction="0,0,0.15")
extrude_2 = Extrude(Base=boundary_surfaces, Direction=expr("x*2", "0,0,0.15"))
area = Area(Geometry=ud_sitegenerateplans.BuildingRoofs)  # -> Area, Centroid
colour_swatch_2 = ColourSwatch(SwatchColor=RGB(102, 102, 102))
custom_preview_2 = CustomPreview(Geometry=ud_sitegenerateplans.BuildingBreps, Material=ColourSwatch(SwatchColor=RGBA(255, 255, 255, 145)))
text_tag_3d = TextTag3D(
    Location=area.Centroid,
    Text=ud_sitegenerateplans.BuildingFloors,
    Size=Slider(5, range=0..10),
    Colour=ColourSwatch(SwatchColor=RGB(0, 0, 0)),
    Justification=7)
custom_preview_3 = CustomPreview(Geometry=ud_sitegenerateplans.BuildingLayers, Material=colour_swatch_2)
custom_preview_4 = CustomPreview(Geometry=extrude_2, Material=colour_swatch)
custom_preview_5 = CustomPreview(Geometry=extrude, Material=ColourSwatch(SwatchColor=RGB(194, 194, 194)))

custom_preview_6 = CustomPreview(Geometry=ud_sitegenerateplans.BuildingRoofs, Material=colour_swatch_2)

# ==== cluster Display
parameter = ClusterInput()
bounds = Bounds(Numbers=parameter)
deconstruct_domain = DeconstructDomain(Domain=bounds)  # -> Start, End
gradient = Gradient(
    LowerLimit=deconstruct_domain.Start,
    UpperLimit=deconstruct_domain.End,
    Parameter=parameter,
    stops=[0: RGB(0, 128, 0), 0.528: RGB(255, 255, 0), 1: RGB(255, 0, 0)])
colour = ClusterOutput(gradient)

# ==== cluster Cluster
brep = ClusterInput()
data = ClusterInput()

# ---- group: H
colour_swatch = ColourSwatch(SwatchColor=RGB(245, 177, 5))

# ---- group: R
colour_swatch_2 = ColourSwatch(SwatchColor=RGB(255, 225, 0))

# ---- group: o
colour_swatch_3 = ColourSwatch(SwatchColor=RGBA(200, 0, 255, 210))

# ---- group: M
colour_swatch_4 = ColourSwatch(SwatchColor=RGB(12, 69, 112))

# ---- group: W
colour_swatch_5 = ColourSwatch(SwatchColor=RGB(104, 75, 150))

# ---- group: c
colour_swatch_6 = ColourSwatch(SwatchColor=RGB(212, 15, 15))

# ----
brep_2 = Brep(flatten(brep))
data_2 = Data(flatten(data))
cset = CreateSet(List=data_2)  # -> Set, Map
mindex = MemberIndex(Set=data_2, Member=cset.Set)  # -> Index, Count
item = ListItem(List=brep_2, Index=mindex.Index, Wrap=True)

merge = Merge(
    Data1=colour_swatch_6,
    Data2=colour_swatch,
    Data3=colour_swatch_2,
    Data4=colour_swatch_3,
    Data5=colour_swatch_4,
    Data6=colour_swatch_5)
txt = Text(merge)
c_script = CSharpScript(labelList=cset.Set, colorList=txt)  # -> A; inputs labelList: list of String, colorList: list of String
# ---------- c_script: C# usings ----------
using Rhino.Display;
# ---------- c_script: C# ----------
    DataTree <string> colorOutput = new DataTree<string>();
    for (int i = 0; i < labelList.Count; i++)
    {
      GH_Path path = new GH_Path(i);
      switch (labelList[i])
      {
        case "C":
          colorOutput.Add(colorList[0], path);
          break;
        case "H":
          colorOutput.Add(colorList[1], path);
          break;
        case "R":
          colorOutput.Add(colorList[2], path);
          break;
        case "O":
          colorOutput.Add(colorList[3], path);
          break;
        case "M":
          colorOutput.Add(colorList[4], path);
          break;
        case "W":
          colorOutput.Add(colorList[5], path);
          break;
      }
    }
    A = colorOutput;
# ---------- end c_script ----------
brep_3 = ClusterOutput(item)
color = ClusterOutput(c_script)
