# Grasshopper definition urbanDesign_createRadomData.gh (Grasshopper 1.0.7)
# plug-ins: UrbanXTools

# ----
# 设计地块（多地块）
curve = Curve([<curve referenced from the Rhino model> x98])

# ----
# 随机参数生成
随机数 = Slider(2, range=0..10)
c_script = CSharpScript(x=curve, seed=随机数)  # -> BlockFunc, BlockFAR, BlockDensity, BlockMixRatio, BlockStyles, BlockAngle; inputs x: list, seed: Int32
# ---------- c_script: C# ----------
    var inputLength = x.Count;
    List<int> funcList = new List<int>();
    List<double> farList = new List<double>();
    List<double> densityList = new List<double>();
    List<double> mixratioList = new List<double>();
    List<int> styleList = new List<int>();
    List<double> angleList = new List<double>();
    var ran = new Random(seed);
    for (int i = 0; i < inputLength; i++)
    {
      var funcKey = ran.Next(4);
      funcList.Add(funcKey);
      if (funcKey == 0)
      {
        var farKey = ran.NextDouble() * (3d - 0.1) + 0.1;;
        var densityKey = ran.NextDouble() * (0.3 - 0.2) + 0.2;
        var mixratioKey = ran.NextDouble() * (0.3 - 0.1) + 0.1;
        int styleKey = ran.Next(2);
        var angleKey = ran.NextDouble() * (0.3 - 0d) + 0d;

        farList.Add(farKey);
        mixratioList.Add(mixratioKey);
        densityList.Add(densityKey);
        styleList.Add(styleKey);
        angleList.Add(angleKey);
      }
      else
      {
        var farKey = ran.NextDouble() * (6d - 1d) + 1d;
        var densityKey = ran.NextDouble() * (0.5 - 0.3) + 0.3;
        var mixratioKey = ran.NextDouble() * (0.5 - 0.1) + 0.1;
        int styleKey = ran.Next(3);
        var angleKey = ran.NextDouble() * (0.3 - 0.1) + 0.1;

        farList.Add(farKey);
        mixratioList.Add(mixratioKey);
        densityList.Add(densityKey);
        styleList.Add(styleKey);
        angleList.Add(angleKey);

      }
    }
    BlockFunc = funcList;
    BlockFAR = farList;
    BlockDensity = densityList;
    BlockMixRatio = mixratioList;
    BlockStyles = styleList;
    BlockAngle = angleList;
# ---------- end c_script ----------

# ----
# 设计路网
curve_2 = Curve([<curve referenced from the Rhino model> x89])

# ----
# 地块类型
用地类型_深标 = ValueList({"居住用地R": 0, "商业用地C": 1, "公共管理用地GIC": 2, "仓储用地": 3, "工业用地": 4}, selected="仓储用地")
用地类型_深标_2 = ValueList({"居住用地R": 0, "商业用地C": 1, "公共管理用地GIC": 2, "仓储用地": 3, "工业用地": 4}, selected="商业用地C")
用地类型_深标_3 = ValueList({"居住用地R": 0, "商业用地C": 1, "公共管理用地GIC": 2, "仓储用地": 3, "工业用地": 4}, selected="居住用地R")
merge = Merge(Data1=用地类型_深标_2, Data2=用地类型_深标_3, Data3=用地类型_深标)

# ----
# 路网可达性计算
na_clearroadsdata = NA_ClearRoadsData(OriginalRoadsData=curve_2)
na_computing = NA_Computing(Roads=na_clearroadsdata, Radius=Slider(6000, range=0..10000), Normalise=Toggle(True))  # -> Metric_Betweenness, Metric_Closeness, Angular_Betweenness, Angular_Closeness
data = Data(na_computing.Metric_Closeness)
display = Display(parameter=data)
custom_preview = CustomPreview(Geometry=na_clearroadsdata, Material=display)

# ----
# 1_计算地块初始参数
ud_siteparameter = UD_SiteParameter(AllRoads=na_clearroadsdata, AllScores=data, AllSites=curve)

# ----
# 2_设定地块目标参数
ud_siteparameterextra = UD_SiteParameterExtra(
    SiteParameters=ud_siteparameter,
    SiteTypes=c_script.BlockFunc,
    SiteFARs=c_script.BlockFAR,
    Densities=c_script.BlockDensity,
    MixRatios=c_script.BlockMixRatio,
    BuidlingStyles=c_script.BlockStyles)

# ----
# 所属城市
value_list = ValueList({"北京": 0, "上海": 1, "天津": 2, "深圳": 3}, selected="北京")

# ----
# 3_生成地块建筑方案
ud_sitegenerateplans = UD_SiteGeneratePlans(SiteParameters=ud_siteparameterextra, CityIndex=value_list)  # -> SiteResults, Sites, FARs, Densities, SubSites, SubSitesSetbacks, BuildingLayers, BuildingRoofs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

# ----
# 功能显示
cluster = Cluster(brep=ud_sitegenerateplans.BuildingBreps, data=ud_sitegenerateplans.BuildingFunctions)  # -> brep_3, color
preview = CustomPreview(Geometry=cluster.brep_3, Material=cluster.color)

panel = Panel(ud_sitegenerateplans.FARs)
panel_2 = Panel(ud_sitegenerateplans.Densities)

# ==== cluster Display
parameter = ClusterInput()
bounds = Bounds(Numbers=parameter)
deconstruct_domain = DeconstructDomain(Domain=bounds)  # -> Start, End
gradient = Gradient(
    LowerLimit=deconstruct_domain.Start,
    UpperLimit=deconstruct_domain.End,
    Parameter=parameter,
    stops=[0: RGB(0, 128, 0), 0.528: RGB(255, 255, 0), 1: RGB(255, 0, 0)])
colour = ClusterOutput(gradient)

# ==== cluster Cluster
brep = ClusterInput()
data = ClusterInput()

# ---- group: H
colour_swatch = ColourSwatch(SwatchColor=RGB(245, 177, 5))

# ---- group: R
colour_swatch_2 = ColourSwatch(SwatchColor=RGB(255, 225, 0))

# ---- group: o
colour_swatch_3 = ColourSwatch(SwatchColor=RGBA(200, 0, 255, 210))

# ---- group: M
colour_swatch_4 = ColourSwatch(SwatchColor=RGB(12, 69, 112))

# ---- group: W
colour_swatch_5 = ColourSwatch(SwatchColor=RGB(104, 75, 150))

# ---- group: c
colour_swatch_6 = ColourSwatch(SwatchColor=RGB(212, 15, 15))

# ----
brep_2 = Brep(flatten(brep))
data_2 = Data(flatten(data))
cset = CreateSet(List=data_2)  # -> Set, Map
mindex = MemberIndex(Set=data_2, Member=cset.Set)  # -> Index, Count
item = ListItem(List=brep_2, Index=mindex.Index, Wrap=True)

merge = Merge(
    Data1=colour_swatch_6,
    Data2=colour_swatch,
    Data3=colour_swatch_2,
    Data4=colour_swatch_3,
    Data5=colour_swatch_4,
    Data6=colour_swatch_5)
txt = Text(merge)
c_script = CSharpScript(labelList=cset.Set, colorList=txt)  # -> A; inputs labelList: list of String, colorList: list of String
# ---------- c_script: C# usings ----------
using Rhino.Display;
# ---------- c_script: C# ----------
    DataTree <string> colorOutput = new DataTree<string>();
    for (int i = 0; i < labelList.Count; i++)
    {
      GH_Path path = new GH_Path(i);
      switch (labelList[i])
      {
        case "C":
          colorOutput.Add(colorList[0], path);
          break;
        case "H":
          colorOutput.Add(colorList[1], path);
          break;
        case "R":
          colorOutput.Add(colorList[2], path);
          break;
        case "O":
          colorOutput.Add(colorList[3], path);
          break;
        case "M":
          colorOutput.Add(colorList[4], path);
          break;
        case "W":
          colorOutput.Add(colorList[5], path);
          break;
      }
    }
    A = colorOutput;
# ---------- end c_script ----------
brep_3 = ClusterOutput(item)
color = ClusterOutput(c_script)
