# Grasshopper definition urbanDesign_singleSite.gh (Grasshopper 1.0.7)
# plug-ins: UrbanXTools

# ----
# 设计路网
curve = Curve([<curve referenced from the Rhino model> x88])

# ----
# 设计地块（单一地块）
curve_2 = Curve(<curve referenced from the Rhino model>)

# ----
# 地块类型
用地类型_深标 = ValueList({"居住用地R": 0, "商业用地C": 1, "公共管理用地GIC": 2, "仓储用地": 3, "工业用地": 4}, selected="商业用地C")

# ----
# 地块目标建筑密度
number_slider = Slider(0.23, range=0..1)

# ----
# 地块目标容积率
number_slider_2 = Slider(2.4, range=0..10)

# ----
# 所属城市
value_list = ValueList({"北京": 0, "上海": 1, "天津": 2, "深圳": 3}, selected="北京")

# ----
# 地块目标功能混合率
number_slider_3 = Slider(0.1, range=0..1)

# ----
# 建筑朝向
number_slider_4 = Slider(0.14, range=-1..1)

# ----
# 地块建筑形态
非住宅建筑形态类型 = ValueList({"单点式": 0, "围合式": 1, "混合式": 2}, selected="单点式")
住宅建筑形态类型 = ValueList({"行列式": 0, "单点式": 1}, selected="行列式")

# ----
# 路网可达性计算
na_clearroadsdata = NA_ClearRoadsData(OriginalRoadsData=curve)
na_computing = NA_Computing(Roads=na_clearroadsdata, Radius=Slider(6000, range=0..10000), Normalise=Toggle(True))  # -> Metric_Betweenness, Metric_Closeness, Angular_Betweenness, Angular_Closeness
data = Data(na_computing.Metric_Closeness)
display = Display(parameter=data)
custom_preview = CustomPreview(Geometry=na_clearroadsdata, Material=display)

# ----
# 1_计算地块初始参数
ud_siteparameter = UD_SiteParameter(AllRoads=na_clearroadsdata, AllScores=data, AllSites=curve_2)

# ----
# 2_设定地块目标参数
ud_siteparameterextra = UD_SiteParameterExtra(
    SiteParameters=ud_siteparameter,
    SiteTypes=用地类型_深标,
    SiteFARs=number_slider_2,
    Densities=number_slider,
    MixRatios=number_slider_3,
    BuidlingStyles=非住宅建筑形态类型,
    MainOritation=number_slider_4)

# ----
# 3_生成地块建筑方案
ud_sitegenerateplans = UD_SiteGeneratePlans(SiteParameters=ud_siteparameterextra, CityIndex=value_list)  # -> SiteResults, Sites, FARs, Densities, SubSites, SubSitesSetbacks, BuildingLayers, BuildingRoofs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

panel = Panel(ud_sitegenerateplans.FARs)
panel_2 = Panel(ud_sitegenerateplans.Densities)

# ----
# 显示设定
colour_swatch = ColourSwatch(SwatchColor=RGB(141, 171, 82))
boundary_surfaces = BoundarySurfaces(Edges=ud_sitegenerateplans.SubSitesSetbacks)
boundary_surfaces_2 = BoundarySurfaces(Edges=ud_sitegenerateplans.SubSites)
extrude = Extrude(Base=boundary_surfaces_2, Direction="0,0,0.15")
extrude_2 = Extrude(Base=boundary_surfaces, Direction=expr("x*2", "0,0,0.15"))
area = Area(Geometry=ud_sitegenerateplans.BuildingRoofs)  # -> Area, Centroid
colour_swatch_2 = ColourSwatch(SwatchColor=RGB(102, 102, 102))
custom_preview_2 = CustomPreview(Geometry=ud_sitegenerateplans.BuildingBreps, Material=ColourSwatch(SwatchColor=RGBA(255, 255, 255, 145)))
text_tag_3d = TextTag3D(
    Location=area.Centroid,
    Text=ud_sitegenerateplans.BuildingFloors,
    Size=Slider(5, range=0..10),
    Colour=ColourSwatch(SwatchColor=RGB(0, 0, 0)),
    Justification=7)
custom_preview_3 = CustomPreview(Geometry=ud_sitegenerateplans.BuildingLayers, Material=colour_swatch_2)
custom_preview_4 = CustomPreview(Geometry=extrude_2, Material=colour_swatch)
custom_preview_5 = CustomPreview(Geometry=extrude, Material=ColourSwatch(SwatchColor=RGB(194, 194, 194)))

custom_preview_6 = CustomPreview(Geometry=ud_sitegenerateplans.BuildingRoofs, Material=colour_swatch_2)

# ==== cluster Display
parameter = ClusterInput()
bounds = Bounds(Numbers=parameter)
deconstruct_domain = DeconstructDomain(Domain=bounds)  # -> Start, End
gradient = Gradient(
    LowerLimit=deconstruct_domain.Start,
    UpperLimit=deconstruct_domain.End,
    Parameter=parameter,
    stops=[0: RGB(0, 128, 0), 0.528: RGB(255, 255, 0), 1: RGB(255, 0, 0)])
colour = ClusterOutput(gradient)
