# Grasshopper definition resoucesDemand.gh (Grasshopper 1.0.7)
# plug-ins: UrbanXTools

# ----
# import road networks
curve = Curve([<curve referenced from the Rhino model> x88])

# ----
# imported sites
# Note: need to ensure that the sites order
# is consistent with the parameter order
curve_2 = Curve([<curve referenced from the Rhino model> x3])

# ----
# city
value_list = ValueList({"BeiJing": 0, "ShangHai": 1, "TianJin": 2, "ShenZhen": 3}, selected="BeiJing")

# ----
# building style
building_style_in_not_r = ValueList({"determinant group": 0, "point group": 1, "mix group": 2}, selected="mix group")
building_style_in_r = ValueList({"determinant group": 0, "point group": 1}, selected="determinant group")
# Note: At present, M and W only contain point group style
building_style_in_r_2 = ValueList({"determinant group": 0, "point group": 1}, selected="point group")

# ----
# building orientation
gene_pool = GenePool(Decimals=3, Maximum=1, Minimum=-1, Value=[0.027, 0.186, 0.404])

# ----
# target FAR
gene_pool_2 = GenePool(Decimals=3, Maximum=10, Minimum=0, Value=[5.031, 2.486, 1.446])

# ----
# target density
gene_pool_3 = GenePool(Decimals=3, Maximum=1, Minimum=0, Value=[0.381, 0.421, 0.275])

# ----
# target mix ratio
gene_pool_4 = GenePool(Decimals=3, Maximum=1, Minimum=0, Value=[0.19, 0.205, 0.275])

# ----
# 地块类型
landuse = ValueList({"R(Residential)": 0, "B(Business)": 1, "A(Administration)": 2, "W(Warehouse)": 3, "M(Industrial)": 4}, selected="B(Business)")
landuse_2 = ValueList({"R(Residential)": 0, "B(Business)": 1, "A(Administration)": 2, "W(Warehouse)": 3, "M(Industrial)": 4}, selected="B(Business)")
landuse_3 = ValueList({"R(Residential)": 0, "B(Business)": 1, "A(Administration)": 2, "W(Warehouse)": 3, "M(Industrial)": 4}, selected="R(Residential)")
merge = Merge(Data1=landuse, Data2=landuse_2, Data3=landuse_3)

merge_2 = Merge(Data1=building_style_in_not_r, Data2=building_style_in_r, Data3=building_style_in_r_2)
ratio_of_dispose_waste = Panel("""0:0.6
1:0.3
2:0.1""")

# ----
# road accessibility
ns_computing3d = NS_Computing3D(RoadsData=curve, Radius=Slider(6000, range=0..10000), Merge=True)  # -> MetricChoice, MetricIntegration, MetricMeanDepth, MetricTotalDepth, AngularChoice, AngularIntegration, AngularMeanDepth, AngularTotalDepth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
data = Data(ns_computing3d.NormalisedAngularChoice)
display = Display(parameter=data)

data_2 = Data(ns_computing3d.CleanedRoadsData)

# ----
# 1_calculate the initial parameters of site
ud_siteparameter = UD_SiteParameter(AllRoads=data_2, AllScores=data, AllSites=curve_2)

# ----
# 2_set target parameters
ud_siteparameterextra = UD_SiteParameterExtra(
    SiteParameters=ud_siteparameter,
    SiteTypes=merge,
    SiteFARs=gene_pool_2,
    Densities=gene_pool_3,
    MixRatios=gene_pool_4,
    BuidlingStyles=merge_2,
    MainOritation=gene_pool)

# ----
# 3_auto-generate urban design
ud_sitegenerateplans = UD_SiteGeneratePlans(SiteParameters=ud_siteparameterextra, CityIndex=value_list)  # -> SiteResults, Sites, FARs, Densities, SubSites, SubSitesSetbacks, BuildingLayers, BuildingRoofs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

custom_preview = CustomPreview(Geometry=data_2, Material=display)

panel = Panel(ud_sitegenerateplans.FARs)
panel_2 = Panel(ud_sitegenerateplans.Densities)

# ----
# visualization_function
cluster = Cluster(brep=ud_sitegenerateplans.BuildingBreps, data=ud_sitegenerateplans.BuildingFunctions)  # -> brep_3, color
preview = CustomPreview(Geometry=cluster.brep_3, Material=cluster.color)

# ---- group: Extract Brep with R
c_script = CSharpScript(x=ud_sitegenerateplans.BuildingBreps, y=ud_sitegenerateplans.BuildingFunctions)  # -> A; inputs x: tree of Brep, y: tree of String
# ---------- c_script: C# ----------
    List<Brep> result = new List<Brep>();
    for (int i = 0; i < y.BranchCount; i++)
    {
      var temp = y.Branch(i);
      for (int j = 0; j < temp.Count; j++)
      {
        var func = temp[j];
        if (func=="R")
        {
          result.Add(x.Branch(i)[j]);
        }else{continue;}
      }
    }
    A = result;
# ---------- end c_script ----------

# ----
# 4_calculate resource load
rd_water = RD_Water(DesignResult=ud_sitegenerateplans.SiteResults)
rd_energy = RD_Energy(DesignResult=ud_sitegenerateplans.SiteResults)
rd_waste = RD_Waste(DesignResult=ud_sitegenerateplans.SiteResults)
panel_3 = Panel(rd_energy)
energydisplay = EnergyDisplay(domain=rd_energy)
wastedisplay = WasteDisplay(domain=rd_waste)
waterdisplay = WaterDisplay(domain=rd_water)
custom_preview_2 = CustomPreview(Geometry=flatten(ud_sitegenerateplans.BuildingBreps), Material=energydisplay)
custom_preview_3 = CustomPreview(Geometry=flatten(ud_sitegenerateplans.BuildingBreps), Material=wastedisplay)
custom_preview_4 = CustomPreview(Geometry=flatten(ud_sitegenerateplans.BuildingBreps), Material=waterdisplay)

rd_population = RD_Population(InputBreps=c_script)
populationdisplay = PopulationDisplay(data=rd_population)
custom_preview_5 = CustomPreview(Geometry=c_script, Material=populationdisplay)
data_3 = Data(flatten(rd_energy))
data_4 = Data(flatten(rd_waste))
mass_addition = MassAddition(Input=data_3)  # -> Result, PartialResults
mass_addition_2 = MassAddition(Input=data_4)  # -> Result, PartialResults

# ----
# 5_calculate carbon emission
sa_energycarbonemissions = SA_EnergyCarbonEmissions(EnergyConsumption=mass_addition.Result)
cluster_2 = Cluster_2(A=mass_addition_2.Result, text=ratio_of_dispose_waste)
panel_4 = Panel(sa_energycarbonemissions)
panel_5 = Panel(cluster_2)

# ----
# visualization
colour_swatch = ColourSwatch(SwatchColor=RGB(141, 171, 82))
boundary_surfaces = BoundarySurfaces(Edges=ud_sitegenerateplans.SubSitesSetbacks)
boundary_surfaces_2 = BoundarySurfaces(Edges=ud_sitegenerateplans.SubSites)
extrude = Extrude(Base=boundary_surfaces_2, Direction="0,0,0.15")
extrude_2 = Extrude(Base=boundary_surfaces, Direction=expr("x*2", "0,0,0.15"))
area = Area(Geometry=ud_sitegenerateplans.BuildingRoofs)  # -> Area, Centroid
colour_swatch_2 = ColourSwatch(SwatchColor=RGB(102, 102, 102))
custom_preview_6 = CustomPreview(Geometry=ud_sitegenerateplans.BuildingBreps, Material=ColourSwatch(SwatchColor=RGBA(255, 255, 255, 145)))
text_tag_3d = TextTag3D(
    Location=area.Centroid,
    Text=ud_sitegenerateplans.BuildingFloors,
    Size=Slider(5, range=0..10),
    Colour=ColourSwatch(SwatchColor=RGB(0, 0, 0)),
    Justification=7)
custom_preview_7 = CustomPreview(Geometry=ud_sitegenerateplans.BuildingLayers, Material=colour_swatch_2)
custom_preview_8 = CustomPreview(Geometry=extrude_2, Material=colour_swatch)
custom_preview_9 = CustomPreview(Geometry=extrude, Material=ColourSwatch(SwatchColor=RGB(194, 194, 194)))
custom_preview_10 = CustomPreview(Geometry=ud_sitegenerateplans.BuildingRoofs, Material=colour_swatch_2)

# ==== cluster Display
parameter = ClusterInput()
bounds = Bounds(Numbers=parameter)
deconstruct_domain = DeconstructDomain(Domain=bounds)  # -> Start, End
gradient = Gradient(
    LowerLimit=deconstruct_domain.Start,
    UpperLimit=deconstruct_domain.End,
    Parameter=parameter,
    stops=[0: RGB(0, 128, 0), 0.528: RGB(255, 255, 0), 1: RGB(255, 0, 0)])
colour = ClusterOutput(gradient)

# ==== cluster Cluster
brep = ClusterInput()
data = ClusterInput()

# ---- group: H
colour_swatch = ColourSwatch(SwatchColor=RGB(245, 177, 5))

# ---- group: R
colour_swatch_2 = ColourSwatch(SwatchColor=RGB(255, 225, 0))

# ---- group: o
colour_swatch_3 = ColourSwatch(SwatchColor=RGBA(200, 0, 255, 210))

# ---- group: M
colour_swatch_4 = ColourSwatch(SwatchColor=RGB(12, 69, 112))

# ---- group: W
colour_swatch_5 = ColourSwatch(SwatchColor=RGB(104, 75, 150))

# ---- group: c
colour_swatch_6 = ColourSwatch(SwatchColor=RGB(212, 15, 15))

# ----
brep_2 = Brep(flatten(brep))
data_2 = Data(flatten(data))
cset = CreateSet(List=data_2)  # -> Set, Map
mindex = MemberIndex(Set=data_2, Member=cset.Set)  # -> Index, Count
item = ListItem(List=brep_2, Index=mindex.Index, Wrap=True)

merge = Merge(
    Data1=colour_swatch_6,
    Data2=colour_swatch,
    Data3=colour_swatch_2,
    Data4=colour_swatch_3,
    Data5=colour_swatch_4,
    Data6=colour_swatch_5)
txt = Text(merge)
c_script = CSharpScript(labelList=cset.Set, colorList=txt)  # -> A; inputs labelList: list of String, colorList: list of String
# ---------- c_script: C# usings ----------
using Rhino.Display;
# ---------- c_script: C# ----------
    DataTree <string> colorOutput = new DataTree<string>();
    for (int i = 0; i < labelList.Count; i++)
    {
      GH_Path path = new GH_Path(i);
      switch (labelList[i])
      {
        case "C":
          colorOutput.Add(colorList[0], path);
          break;
        case "H":
          colorOutput.Add(colorList[1], path);
          break;
        case "R":
          colorOutput.Add(colorList[2], path);
          break;
        case "O":
          colorOutput.Add(colorList[3], path);
          break;
        case "M":
          colorOutput.Add(colorList[4], path);
          break;
        case "W":
          colorOutput.Add(colorList[5], path);
          break;
      }
    }
    A = colorOutput;
# ---------- end c_script ----------
brep_3 = ClusterOutput(item)
color = ClusterOutput(c_script)

# ==== cluster EnergyDisplay
domain = ClusterInput()
deconstruct_domain = DeconstructDomain(Domain=domain)  # -> Start, End
data = Data(flatten(deconstruct_domain.End))
bounds = Bounds(Numbers=data)
deconstruct_domain_2 = DeconstructDomain(Domain=bounds)  # -> Start, End
gradient = Gradient(
    LowerLimit=deconstruct_domain_2.Start,
    UpperLimit=deconstruct_domain_2.End,
    Parameter=data,
    stops=[0.162: RGBA(252, 174, 174, 180), 0.751: RGBA(191, 0, 0, 188)])
colour = ClusterOutput(gradient)

# ==== cluster WasteDisplay
domain = ClusterInput()
deconstruct_domain = DeconstructDomain(Domain=domain)  # -> Start, End
data = Data(flatten(deconstruct_domain.End))
bounds = Bounds(Numbers=data)
deconstruct_domain_2 = DeconstructDomain(Domain=bounds)  # -> Start, End
gradient = Gradient(
    LowerLimit=deconstruct_domain_2.Start,
    UpperLimit=deconstruct_domain_2.End,
    Parameter=data,
    stops=[0.174: RGBA(134, 135, 194, 180), 0.81: RGBA(34, 0, 115, 188)])
colour = ClusterOutput(gradient)

# ==== cluster WaterDisplay
domain = ClusterInput()
deconstruct_domain = DeconstructDomain(Domain=domain)  # -> Start, End
data = Data(flatten(deconstruct_domain.End))
bounds = Bounds(Numbers=data)
deconstruct_domain_2 = DeconstructDomain(Domain=bounds)  # -> Start, End
gradient = Gradient(
    LowerLimit=deconstruct_domain_2.Start,
    UpperLimit=deconstruct_domain_2.End,
    Parameter=data,
    stops=[0.195: RGBA(134, 166, 194, 180), 0.77: RGBA(19, 115, 189, 188)])
colour = ClusterOutput(gradient)

# ==== cluster PopulationDisplay
data = ClusterInput()
data_2 = Data(flatten(data))
bounds = Bounds(Numbers=data_2)
deconstruct_domain = DeconstructDomain(Domain=bounds)  # -> Start, End
gradient = Gradient(
    LowerLimit=deconstruct_domain.Start,
    UpperLimit=deconstruct_domain.End,
    Parameter=data_2,
    stops=[0: RGB(255, 255, 255), 1: RGB(0, 0, 0)])
colour = ClusterOutput(gradient)

# ==== cluster Cluster_2
A = ClusterInput()
text = ClusterInput()
text_split = TextSplit(Text=text, Separators=":")
flip_matrix = FlipMatrix(Data=text_split)
explode_tree = ExplodeTree(Data=flip_matrix)  # -> Branch0, Branch1
multiplication = Multiplication(A=A, B=explode_tree.Branch1)
list_item = ListItem(List=multiplication, Index=0, Wrap=True)  # -> Item, Item1, Item2
list_item_2 = ListItem(List=explode_tree.Branch0, Index=0, Wrap=True)  # -> Item, Item1, Item2
sa_wastecarbonemissions = SA_WasteCarbonEmissions(WasteGeneration=list_item.Item1, WasteTreatment=list_item_2.Item1)
sa_wastecarbonemissions_2 = SA_WasteCarbonEmissions(WasteGeneration=list_item.Item2, WasteTreatment=list_item_2.Item2)
sa_wastecarbonemissions_3 = SA_WasteCarbonEmissions(WasteGeneration=list_item.Item, WasteTreatment=list_item_2.Item)
merge = Merge(Data1=sa_wastecarbonemissions_3, Data2=sa_wastecarbonemissions, Data3=sa_wastecarbonemissions_2)
result = ClusterOutput(merge)
