# Grasshopper definition ExposureRates.gh (Grasshopper 1.0.7)
# plug-ins: UrbanXTools

# ----
# 设计路网
curve = Curve([<curve referenced from the Rhino model> x88])

# ----
# 建筑体块
brep = Brep([<brep referenced from the Rhino model> x121])

point = Point([Point(5979.127743, 7406.406558, 0), Point(5202.002203, 7405.925719, 0), Point(5203.273666, 7943.691767, 0), Point(5982.829741, 7943.069152, 0), Point(5984.219204, 8144.493589, 0), Point(6445.098229, 7939.094783, 0)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])
sa_exposurerate = SA_ExposureRate(InputBreps=brep, InputPts=point, Nomalized=True, Radius=500, Segments=20)  # -> OutputLines, OutputExposureRates

# ----
# 路网可达性计算
na_clearroadsdata = NA_ClearRoadsData(OriginalRoadsData=curve)
custom_preview = CustomPreview(
    Geometry=na_clearroadsdata,
    Material={diffuse=RGB(221, 160, 221), emission=RGB(66, 48, 66), shine=0.5, specular=RGB(255, 255, 255), transparency=0})

data = Data(flatten(sa_exposurerate.OutputExposureRates))
bounds = Bounds(Numbers=data)
deconstruct_domain = DeconstructDomain(Domain=bounds)  # -> Start, End
gradient = Gradient(
    LowerLimit=deconstruct_domain.Start,
    UpperLimit=deconstruct_domain.End,
    Parameter=data,
    stops=[0: RGB(234, 38, 0), 0.208: RGB(234, 126, 0), 0.457: RGB(254, 244, 84), 0.74: RGB(173, 203, 249), 1: RGB(75, 107, 169)])

# ----
# 4_资源荷载量计算
energydisplay = EnergyDisplay(data=flatten(sa_exposurerate.OutputExposureRates))
custom_preview_2 = CustomPreview(Geometry=flatten(sa_exposurerate.OutputLines), Material=gradient)

# ==== cluster EnergyDisplay
data = ClusterInput()
bounds = Bounds()
deconstruct_domain = DeconstructDomain(Domain=bounds)  # -> Start, End
gradient = Gradient(
    LowerLimit=deconstruct_domain.Start,
    UpperLimit=deconstruct_domain.End,
    stops=[0: RGB(234, 38, 0), 0.25: RGB(234, 126, 0), 0.5: RGB(254, 244, 84), 0.75: RGB(173, 203, 249), 1: RGB(75, 107, 169)])
colour = ClusterOutput(gradient)
