# Grasshopper definition ExposureRates3D_mesh.gh (Grasshopper 1.0.7)
# plug-ins: UrbanXTools, Other Assembly

# ---- group: visiting path
curve = Curve(<curve referenced from the Rhino model>)

# ---- group: imported mesh
mesh = Mesh([<mesh referenced from the Rhino model> x38])

# ----
mesh_join = MeshJoin(Meshes=mesh)
weld_mesh = WeldMesh(Mesh=mesh_join, Angle=3.141592654)
spatial_analysis_generatemesh_mesh = Spatial_Analysis_GenerateMesh_Mesh(Mesh=weld_mesh, VisualGraphCalc=False)
view_radius = Slider(10, range=0..100)
divide_curve = DivideCurve(Curve=curve, Count=10, Kinks=False)  # -> Points, Tangents, Parameters
spatial_analysis_exposurerate3d_mesh = Spatial_Analysis_ExposureRate3D_Mesh(ViewPt=divide_curve.Points, GeneratedMeshClass=spatial_analysis_generatemesh_mesh, ViewRange=view_radius)  # -> ColoredMesh, MeshIntrCount, VisData
cluster = Cluster(data=spatial_analysis_exposurerate3d_mesh.MeshIntrCount)

# ---- group: highlight value
panel = Panel(spatial_analysis_exposurerate3d_mesh.VisData)
list_item = ListItem(List=panel, Index=0, Wrap=True)  # -> flatten(Item)
ghpython_script = GhPythonScript(x=list_item)  # -> a; inputs x: list
# ---------- ghpython_script: Python ----------
result=[]
for i in range(len(x)):
    result.append(round(x[i],2))
a=result
# ---------- end ghpython_script ----------
text_tag_3d = TextTag3D(
    Location=divide_curve.Points,
    Text=ghpython_script,
    Size=1,
    Colour=ColourSwatch(SwatchColor=RGB(0, 0, 0)),
    Justification=7)

# ----
gradient = Gradient(LowerLimit=0, UpperLimit=1, Parameter=cluster, stops=[0: RGB(0, 128, 0), 0.5: RGB(255, 255, 0), 1: RGB(255, 0, 0)])

# ---- group: adjust color
deconstruct_mesh = DeconstructMesh(Mesh=spatial_analysis_exposurerate3d_mesh.ColoredMesh)  # -> Vertices, Faces, Colours, Normals
construct_mesh = ConstructMesh(Vertices=deconstruct_mesh.Vertices, Faces=deconstruct_mesh.Faces, Colours=gradient)

# ==== cluster Cluster
data = ClusterInput()
data_2 = Data(data)
bounds = Bounds(Numbers=data_2)
remap_numbers = RemapNumbers(Value=data_2, Source=bounds, Target=Domain(0, 1))  # -> Mapped, Clipped
mapped = ClusterOutput(remap_numbers.Mapped)
