# Grasshopper definition Aided Regulatory Planning.gh (Grasshopper 1.0.7)
# plug-ins: UrbanXTools, Human

# ---- group: imported sites
curve = Curve([<curve referenced from the Rhino model> x85])

# ---- group: radius
radius_1 = Slider(1200, range=0..10000)
radius_3 = Slider(300, range=0..10000)
radius_2 = Slider(500, range=0..10000)

# ---- group: imported road networks
# Legend for panel
# Stand for input data
# Stand for calculation result
curve_2 = Curve([<curve referenced from the Rhino model> x41])

# ----
merge = Merge(Data1=radius_1, Data2=radius_2, Data3=radius_3)

# ----
# visulization_road accessibility
data = Data()
bounds = Bounds(Numbers=data)
deconstruct_domain = DeconstructDomain(Domain=bounds)  # -> Start, End
gradient = Gradient(
    LowerLimit=deconstruct_domain.Start,
    UpperLimit=deconstruct_domain.End,
    Parameter=data,
    stops=[0: RGB(0, 60, 255), 0.293: RGB(0, 128, 0), 0.628: RGB(255, 255, 0), 1: RGB(255, 0, 0)])
custom_preview = CustomPreview(Material=gradient)

# ----
# calculation_road accessibility
boolean_toggle = BooleanToggle(True)
ns_computing3d = NS_Computing3D(RoadsData=curve_2, Radius=radius_2, Merge=boolean_toggle)  # -> MetricChoice, MetricIntegration, MetricMeanDepth, MetricTotalDepth, AngularChoice, AngularIntegration, AngularMeanDepth, AngularTotalDepth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
ns_computing3d_2 = NS_Computing3D(RoadsData=curve_2, Radius=radius_3, Merge=boolean_toggle)  # -> MetricChoice, MetricIntegration, MetricMeanDepth, MetricTotalDepth, AngularChoice, AngularIntegration, AngularMeanDepth, AngularTotalDepth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
ns_computing3d_3 = NS_Computing3D(RoadsData=curve_2, Radius=radius_1, Merge=boolean_toggle)  # -> MetricChoice, MetricIntegration, MetricMeanDepth, MetricTotalDepth, AngularChoice, AngularIntegration, AngularMeanDepth, AngularTotalDepth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

# ---- group: cleanedRoads
data_2 = Data(ns_computing3d_3.CleanedRoadsData)

# ---- group: imported sites
data_3 = Data(curve)

# ----
# calculation_site accessibility
na_siteaccessibility = NA_SiteAccessibility(CleanedRoadsData=data_2, RoadsScores=ns_computing3d_3.NormalisedAngularChoice, SitesCurves=data_3)  # -> SitesPolygons, SiteScores
na_siteaccessibility_2 = NA_SiteAccessibility(CleanedRoadsData=data_2, RoadsScores=ns_computing3d.NormalisedAngularChoice, SitesCurves=data_3)  # -> SitesPolygons, SiteScores
na_siteaccessibility_3 = NA_SiteAccessibility(CleanedRoadsData=data_2, RoadsScores=ns_computing3d_2.NormalisedAngularChoice, SitesCurves=data_3)  # -> SitesPolygons, SiteScores
merge_2 = Merge(
    Data1=graft(na_siteaccessibility.SiteScores),
    Data2=graft(na_siteaccessibility_2.SiteScores),
    Data3=graft(na_siteaccessibility_3.SiteScores))  # -> simplify(Result)

# ----
# visulization_site accessibility
data_4 = Data()
bounds_2 = Bounds(Numbers=data_4)
deconstruct_domain_2 = DeconstructDomain(Domain=bounds_2)  # -> Start, End
gradient_2 = Gradient(
    LowerLimit=deconstruct_domain_2.Start,
    UpperLimit=deconstruct_domain_2.End,
    Parameter=data_4,
    stops=[0: RGB(12, 82, 235), 0.379: RGB(0, 128, 0), 0.685: RGB(255, 255, 0), 1: RGB(255, 0, 0)])
custom_preview_2 = CustomPreview(Material=gradient_2)

# ---- group: cleanedRoads
data_5 = Data(data_2)

# ---- group: cleanedSites
data_6 = Data(na_siteaccessibility.SitesPolygons)

# ----
area = Area(Geometry=data_6)  # -> Area, Centroid

# ----
# calculation_site clustering
rp_clusteringpoints = RP_ClusteringPoints(SitesCentroid=area.Centroid, Diameters=merge)  # -> ClusterLinks, SiteIds, Out
data_7 = Data(rp_clusteringpoints.ClusterLinks)
data_8 = Data(rp_clusteringpoints.SiteIds)
tree_statistics = TreeStatistics(Tree=data_8)  # -> Paths, Length, Count
cluster = Cluster(tree=data_7)  # -> colour, tree_2
custom_preview_lineweights = CustomPreviewLineweights(Geometry=cluster.tree_2, Shader=simplify(graft(cluster.colour)), Thickness=Slider(3, range=0..10), Absolute=False)

# ----
# calculation_site landuse allocation
landuse_ratio = Panel("""B:0.50
A:0.06
R:0.32
W:0.10
G:0.04
M:0""")
na_landuseallocation = NA_LanduseAllocation(SiteCrvs=data_6, SiteScore=merge_2, Clusters=rp_clusteringpoints.Out, LandusePriorityAndPct=landuse_ratio)  # -> SiteLanduse, SitesPercentage, sitePct, model
calcresult_landuse_ratio = Panel(na_landuseallocation.sitePct)
boundary_surfaces = BoundarySurfaces(Edges=graft(na_landuseallocation.SiteLanduse))  # -> flatten(Surfaces)

# ---- group: R
colour_swatch = ColourSwatch(SwatchColor=RGB(255, 247, 0))

# ---- group: A1
colour_swatch_2 = ColourSwatch(SwatchColor=RGB(255, 0, 255))

# ---- group: G
colour_swatch_3 = ColourSwatch(SwatchColor=RGB(109, 168, 0))

# ---- group: B
colour_swatch_4 = ColourSwatch(SwatchColor=RGB(255, 0, 0))

# ---- group: M
colour_swatch_5 = ColourSwatch(SwatchColor=RGB(133, 86, 37))

# ---- group: W
colour_swatch_6 = ColourSwatch(SwatchColor=RGB(37, 42, 133))

# ----
merge_3 = Merge(
    Data1=colour_swatch,
    Data2=colour_swatch_2,
    Data3=colour_swatch_3,
    Data4=colour_swatch_4,
    Data5=colour_swatch_5,
    Data6=colour_swatch_6)
txt = Text(merge_3)
cluster_2 = Cluster_2(L=boundary_surfaces, data=na_landuseallocation.SitesPercentage)  # -> I, i, S
c_script = CSharpScript(labelList=cluster_2.S, colorList=txt)  # -> A; inputs labelList: list of String, colorList: list of String
# ---------- c_script: C# usings ----------
using Rhino.Display;
# ---------- c_script: C# ----------
    DataTree <string> colorOutput = new DataTree<string>();
    for (int i = 0; i < labelList.Count; i++)
    {
      GH_Path path = new GH_Path(i);
      switch (labelList[i])
      {
        case "R":
          colorOutput.Add(colorList[0], path);
          break;
        case "A":
          colorOutput.Add(colorList[1], path);
          break;
        case "G":
          colorOutput.Add(colorList[2], path);
          break;
        case "B":
          colorOutput.Add(colorList[3], path);
          break;
        case "M":
          colorOutput.Add(colorList[4], path);
          break;
        case "W":
          colorOutput.Add(colorList[5], path);
          break;
      }
    }
    A = colorOutput;
# ---------- end c_script ----------
preview = CustomPreview(Geometry=cluster_2.i, Material=c_script)

# ----
# calculation_site accessibility reallocation
na_siteaccessibility_4 = NA_SiteAccessibility(
    CleanedRoadsData=data_5,
    RoadsScores=ns_computing3d_3.NormalisedAngularChoice,
    SitesCurves=na_landuseallocation.SiteLanduse)  # -> SitesPolygons, SiteScores
na_siteaccessibility_5 = NA_SiteAccessibility(
    CleanedRoadsData=data_5,
    RoadsScores=ns_computing3d.NormalisedAngularChoice,
    SitesCurves=na_landuseallocation.SiteLanduse)  # -> SitesPolygons, SiteScores
na_siteaccessibility_6 = NA_SiteAccessibility(
    CleanedRoadsData=data_5,
    RoadsScores=ns_computing3d_2.NormalisedAngularChoice,
    SitesCurves=na_landuseallocation.SiteLanduse)  # -> SitesPolygons, SiteScores
cluster_3 = Cluster_4(data=na_siteaccessibility_4.SiteScores)
cluster_4 = Cluster_4(data=na_siteaccessibility_5.SiteScores)
cluster_5 = Cluster_4(data=na_siteaccessibility_6.SiteScores)
ratio_in_each_kind_of_accessibility = Panel("""0.5
0.3
0.2""")
merge_4 = Merge(Data1=graft(cluster_3), Data2=graft(cluster_4), Data3=graft(cluster_5))  # -> simplify(Result)
c_script_2 = CSharpScript(x=merge_4, y=ratio_in_each_kind_of_accessibility)  # -> flatten(A); inputs x: tree of Double, y: list of Double
# ---------- c_script_2: C# usings ----------
using System.Linq;
# ---------- c_script_2: C# ----------
    DataTree<double> result = new DataTree<double>();
    for (int i = 0; i < x.BranchCount; i++)
    {
      List<double> tempList = new List<double>();
      GH_Path path = new GH_Path(i);
      for (int j = 0; j < x.Branch(i).Count; j++)
      {
        var temp = x.Branch(i)[j]*y[j];
        tempList.Add(temp);
      }
      result.Add(tempList.Sum(),path);
      
    }
    A = result;
# ---------- end c_script_2 ----------

# ----
# calculation_site FAR allocation
construction_area_in_each_landuse = Panel("""A:0.073366
B:0.453912
G:0
M:0
W:0.08552
R:0.387200""")
total_construction_area = Panel("5891000")
rp_farallocation = RP_FarAllocation(
    Model_LanduseAllocation=na_landuseallocation.model,
    TotalArea=total_construction_area,
    FARRatio=construction_area_in_each_landuse,
    InputNach=c_script_2)
area_2 = Area(Geometry=na_landuseallocation.SiteLanduse)  # -> Area, Centroid
cluster_6 = Cluster_7(A=area_2.Area, B=rp_farallocation)
calcresult_total_construction_area = Panel(cluster_6)
cluster_7 = Cluster_6(B=cluster_6, data=na_landuseallocation.SitesPercentage, list_2=area_2.Area, list=rp_farallocation)
calcresult_construction_area_in_each_lan = Panel(cluster_7)  # "CalcResult_Construction Area in Each Landuse"

# ----
# visualization_site Landuse&FAR
number_slider = Slider(300, range=0..1000)
split_argb = SplitARGB(Colour=merge_3, IntegerChannels=True)  # -> Alpha, Red, Green, Blue
cluster_8 = Cluster_3(
    edges=na_landuseallocation.SiteLanduse,
    data_2=na_landuseallocation.SitesPercentage,
    data=rp_farallocation,
    domain_end=number_slider)  # -> unit_vector, extrusion, i, S
colour_rgb = ColourRGB(Alpha=Slider(255, range=0..255), Red=split_argb.Red, Green=split_argb.Green, Blue=split_argb.Blue)
move = Move(Geometry=area_2.Centroid, Motion=cluster_8.unit_vector)  # -> Geometry, Transform
c_script_3 = CSharpScript(labelList=cluster_8.S, colorList=colour_rgb)  # -> A; inputs labelList: list of String, colorList: list of Color
# ---------- c_script_3: C# usings ----------
using Rhino.Display;
using System.Drawing;
# ---------- c_script_3: C# ----------
    DataTree <Color> colorOutput = new DataTree<Color>();
    for (int i = 0; i < labelList.Count; i++)
    {
      GH_Path path = new GH_Path(i);
      switch (labelList[i])
      {
        case "R":
          colorOutput.Add(colorList[0], path);
          break;
        case "A":
          colorOutput.Add(colorList[1], path);
          break;
        case "G":
          colorOutput.Add(colorList[2], path);
          break;
        case "B":
          colorOutput.Add(colorList[3], path);
          break;
        case "M":
          colorOutput.Add(colorList[4], path);
          break;
        case "W":
          colorOutput.Add(colorList[5], path);
          break;
      }
    }
    A = colorOutput;
# ---------- end c_script_3 ----------
text_tag_3d = TextTag3D(
    Location=move.Geometry,
    Text=rp_farallocation,
    Size=Slider(22, range=0..100),
    Colour=ColourSwatch(SwatchColor=RGB(0, 0, 0)),
    Justification=7)
preview_2 = CustomPreview(Geometry=simplify(cluster_8.i), Material=c_script_3)

# ==== cluster Cluster
tree = ClusterInput()
trim_tree = TrimTree(Tree=tree, Depth=1)
tree_2 = ClusterOutput(trim_tree)
tree_statistics = TreeStatistics(Tree=trim_tree)  # -> Paths, Length, Count
series = Series(Start=0, Step=1, Count=tree_statistics.Count)
bounds = Bounds(Numbers=series)
remap_numbers = RemapNumbers(Value=series, Source=bounds, Target=Domain(0, 1))  # -> Mapped, Clipped
gradient = Gradient(
    LowerLimit=0,
    UpperLimit=1,
    Parameter=remap_numbers.Mapped,
    stops=[0: RGB(0, 128, 0), 0.5: RGB(255, 255, 0), 1: RGB(255, 0, 0)])
colour = ClusterOutput(gradient)

# ==== cluster Cluster_2
data = ClusterInput()
L = ClusterInput()

data_2 = Data(flatten(data))
cset = CreateSet(List=data_2)  # -> Set, Map
mindex = MemberIndex(Set=data_2, Member=cset.Set)  # -> Index, Count
item = ListItem(List=L, Index=mindex.Index, Wrap=True)

S = ClusterOutput(cset.Set)
I = ClusterOutput(mindex.Index)
i = ClusterOutput(item)

# ==== cluster Cluster_3
domain_end = ClusterInput()
construct_domain = ConstructDomain(DomainStart="1", DomainEnd=domain_end)
data = ClusterInput()
data_2 = ClusterInput()
edges = ClusterInput()
data_3 = Data(data)
bounds = Bounds(Numbers=data_3)
boundary_surfaces = BoundarySurfaces(Edges=graft(edges))
remap_numbers = RemapNumbers(Value=data_3, Source=bounds, Target=Domain(0, 1))  # -> Mapped, Clipped
graph_mapper = GraphMapper(
    remap_numbers.Mapped,
    x0=0,
    x1=1,
    y0=0,
    y1=1,
    container_name="Bezier",
    cpx=[0, 0.7485014796, 0.5181000829, 1],
    cpy=[0, 0.2153329253, 0.5784673691, 0.8697323799])
remap_numbers_2 = RemapNumbers(Value=graph_mapper, Source=Domain(0, 1), Target=construct_domain)  # -> Mapped, Clipped
unit_z = UnitZ(Factor=remap_numbers_2.Mapped)
extrude = Extrude(Base=boundary_surfaces, Direction=graft(unit_z))
cluster = Cluster_2(L=flatten(extrude), data=data_2)  # -> I, i, S
unit_vector = ClusterOutput(unit_z)
extrusion = ClusterOutput(extrude)
i = ClusterOutput(cluster.i)
S = ClusterOutput(cluster.S)

# ==== cluster Cluster_4
data = ClusterInput()
data_2 = Data(data)
bounds = Bounds(Numbers=data_2)
remap_numbers = RemapNumbers(Value=data_2, Source=bounds, Target=Domain(0, 1))  # -> Mapped, Clipped
mapped = ClusterOutput(remap_numbers.Mapped)

# ==== cluster Cluster_6
data = ClusterInput()
list = ClusterInput()
list_2 = ClusterInput()
data_2 = Data(data)
cluster = Cluster_5(list=list, data=data_2)  # -> i, set
cluster_2 = Cluster_5(list=list_2, data=data_2)  # -> i, set
multiplication = Multiplication(A=cluster_2.i, B=cluster.i)
mass_addition = MassAddition(Input=multiplication)  # -> Result, PartialResults
B = ClusterInput()
division = Division(A=mass_addition.Result, B=B)
concatenate = Concatenate(Fragment_A=cluster_2.set, Fragment_B=flatten(":"), A=flatten(division))
result = ClusterOutput(concatenate)

# ==== cluster Cluster_7
A = ClusterInput()
B = ClusterInput()
multiplication = Multiplication(A=A, B=B)
mass_addition = MassAddition(Input=multiplication)  # -> Result, PartialResults
result = ClusterOutput(mass_addition.Result)

# ==== cluster Cluster_5
data = ClusterInput()
data_2 = Data(data)
create_set = CreateSet(List=data_2)  # -> Set, Map
member_index = MemberIndex(Set=data_2, Member=create_set.Set)  # -> Index, Count
list = ClusterInput()
list_item = ListItem(List=list, Index=member_index.Index, Wrap=True)  # -> simplify(Item)
i = ClusterOutput(list_item)
set = ClusterOutput(create_set.Set)
