# Grasshopper definition centroidLineExtract.gh (Grasshopper 1.0.7)
# plug-ins: UrbanXTools

curve = Curve([<curve referenced from the Rhino model> x1573])
centerlineextraction = CenterLineExtraction(
    InputCurve=curve,
    GridSize=Slider(1000, range=0..1000),
    BufferDist=Slider(80, range=0..100),
    InterpolateDist=Slider(40, range=0..100),
    Epsilon=Slider(100, range=0..100),
    SegmentThreshold=10)

curve_2 = Curve([<curve referenced from the Rhino model> x18])
centerlineextractionfrombuffer = CenterLineExtractionFromBuffer(InputCurve=curve_2, InterpolateDist=Slider(100, range=0..1000), Epsilon=Slider(50, range=0..1000), SegmentThreshold=10)
