# Grasshopper definition CutomizeSegmentScore.gh (Grasshopper 1.0.7)
# plug-ins: UrbanXTools

curve = Curve([<curve referenced from the Rhino model> x62])
ns_roadssplitter = NS_RoadsSplitter(OriginalCurves=curve)
length = Length(Curve=ns_roadssplitter)
va_visualsyntaxcompute = VA_VisualSyntaxCompute(CleanedRoads=ns_roadssplitter, ScoreOnRoads=length, Radius="-1")  # -> VisualTotalDepth, VisualMeanDepth, VisualIntegration, VisualChoice, NormalisedVisualIntegration, NormalisedVisualChoice
data = Data(va_visualsyntaxcompute.VisualTotalDepth)
bounds = Bounds(Numbers=data)
deconstruct_domain = DeconstructDomain(Domain=bounds)  # -> Start, End
gradient = Gradient(
    LowerLimit=deconstruct_domain.Start,
    UpperLimit=deconstruct_domain.End,
    Parameter=data,
    stops=[0: RGB(234, 38, 0), 0.25: RGB(234, 126, 0), 0.5: RGB(254, 244, 84), 0.75: RGB(173, 203, 249), 1: RGB(75, 107, 169)])
custom_preview = CustomPreview(Geometry=ns_roadssplitter, Material=gradient)
